# Grasshopper definition PV_potential.gh (Grasshopper 0.9.76)
# plug-ins: DIVA Daylight

# ----
# Surface
# Section 3
srf = Surface()

# ----
# Grasshopper - PV Potential
# Surface
# Section 1
srf_2 = Surface()

# ----
# Surface
# Section 2
srf_3 = Surface()

# ----
# Shadow Model
mesh = Mesh()

# ----
# Shadow Model
mesh_2 = Mesh()

# ----
# Shadow Model
mesh_3 = Mesh()

# ----
# Telhado 11
# Modelo Sombra
# Telhado 12
# Modelo Sombra
# Telhado 13
# Modelo Sombra
button = Button()
obj = SceneObject(
    Geometry=mesh,
    BooleanValue_0=False,
    BooleanValue_1=False,
    Color_0=RGBA(0, 0, 0, 0),
    Color_1=RGBA(0, 0, 0, 0),
    Hidden_0=False,
    Hidden_1=False,
    IntegerValue_0=-2147483648,
    IntegerValue_1=-2147483648,
    IntervalMax_0=-1.797693135e+308,
    IntervalMax_1=-1.797693135e+308,
    IntervalMin_0=-1.797693135e+308,
    IntervalMin_1=-1.797693135e+308,
    Name_0="Geometry",
    Name_1="Material",
    NumberValue_0=-1.797693135e+308,
    NumberValue_1=-1.797693135e+308,
    OutputHidden_0=False,
    OutputName_0="Scene Object",
    TextValuePersistent_1="OutsideFacade_30",
    TextValueVolatile_1="OutsideFacade_30")
grid = DaylightingGrid(
    Geometry=srf,
    Spacing=0.45,
    BooleanValue_0=False,
    BooleanValue_1=False,
    BooleanValue_10=False,
    BooleanValue_11=False,
    BooleanValue_12=False,
    BooleanValue_13=False,
    BooleanValue_14=False,
    BooleanValue_15=False,
    BooleanValue_16=False,
    BooleanValue_17=False,
    BooleanValue_18=False,
    BooleanValue_19=False,
    BooleanValue_2=False,
    BooleanValue_20=False,
    BooleanValue_21=False,
    BooleanValue_22=False,
    BooleanValue_3=False,
    BooleanValue_4=False,
    BooleanValue_5=False,
    BooleanValue_6=False,
    BooleanValue_7=False,
    BooleanValue_8=False,
    BooleanValue_9=False,
    Color_0=RGBA(0, 0, 0, 0),
    Color_1=RGBA(0, 0, 0, 0),
    Color_10=RGBA(0, 0, 0, 0),
    Color_11=RGBA(0, 0, 0, 0),
    Color_12=RGBA(0, 0, 0, 0),
    Color_13=RGBA(0, 0, 0, 0),
    Color_14=RGBA(0, 0, 0, 0)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)
rad_map = RadiationMap(
    Name="PV",
    Grids=grid,
    Objects=obj,
    RhinoScene=Toggle(True),
    Run=button,
    BooleanValue_0=False,
    BooleanValue_1=False,
    BooleanValue_10=False,
    BooleanValue_11=False,
    BooleanValue_12=False,
    BooleanValue_13=False,
    BooleanValue_14=False,
    BooleanValue_15=False,
    BooleanValue_16=False,
    BooleanValue_17=False,
    BooleanValue_18=False,
    BooleanValue_19=False,
    BooleanValue_2=False,
    BooleanValue_3=True,
    BooleanValue_4=False,
    BooleanValue_5=False,
    BooleanValue_6=False,
    BooleanValue_7=False,
    BooleanValue_8=False,
    BooleanValue_9=False,
    Color_0=RGBA(0, 0, 0, 0),
    Color_1=RGBA(0, 0, 0, 0),
    Color_10=RGBA(0, 0, 0, 0),
    Color_11=RGBA(0, 0, 0, 0),
    Color_12=RGBA(0, 0, 0, 0),
    Color_13=RGBA(0, 0, 0, 0),
    Color_14=RGBA(0, 0, 0, 0),
    Color_15=RGBA(0, 0, 0, 0),
    Color_16=RGBA(0, 0, 0, 0),
    Color_17=RGBA(0, 0, 0, 0)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)  # -> Out, SolarEnergy, EnergyDensity, Grid

obj_2 = SceneObject(
    Geometry=mesh_3,
    BooleanValue_0=False,
    BooleanValue_1=False,
    Color_0=RGBA(0, 0, 0, 0),
    Color_1=RGBA(0, 0, 0, 0),
    Hidden_0=False,
    Hidden_1=False,
    IntegerValue_0=-2147483648,
    IntegerValue_1=-2147483648,
    IntervalMax_0=-1.797693135e+308,
    IntervalMax_1=-1.797693135e+308,
    IntervalMin_0=-1.797693135e+308,
    IntervalMin_1=-1.797693135e+308,
    Name_0="Geometry",
    Name_1="Material",
    NumberValue_0=-1.797693135e+308,
    NumberValue_1=-1.797693135e+308,
    OutputHidden_0=False,
    OutputName_0="Scene Object",
    TextValuePersistent_1="OutsideFacade_30",
    TextValueVolatile_1="OutsideFacade_30")
grid_2 = DaylightingGrid(
    Geometry=srf_3,
    Spacing=0.45,
    BooleanValue_0=False,
    BooleanValue_1=False,
    BooleanValue_10=False,
    BooleanValue_11=False,
    BooleanValue_12=False,
    BooleanValue_13=False,
    BooleanValue_14=False,
    BooleanValue_15=False,
    BooleanValue_16=False,
    BooleanValue_17=False,
    BooleanValue_18=False,
    BooleanValue_19=False,
    BooleanValue_2=False,
    BooleanValue_20=False,
    BooleanValue_21=False,
    BooleanValue_22=False,
    BooleanValue_3=False,
    BooleanValue_4=False,
    BooleanValue_5=False,
    BooleanValue_6=False,
    BooleanValue_7=False,
    BooleanValue_8=False,
    BooleanValue_9=False,
    Color_0=RGBA(0, 0, 0, 0),
    Color_1=RGBA(0, 0, 0, 0),
    Color_10=RGBA(0, 0, 0, 0),
    Color_11=RGBA(0, 0, 0, 0),
    Color_12=RGBA(0, 0, 0, 0),
    Color_13=RGBA(0, 0, 0, 0),
    Color_14=RGBA(0, 0, 0, 0)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)
rad_map_2 = RadiationMap(
    Name="PV",
    Grids=grid_2,
    Objects=obj_2,
    RhinoScene=Toggle(True),
    Run=Button(),
    BooleanValue_0=False,
    BooleanValue_1=False,
    BooleanValue_10=False,
    BooleanValue_11=False,
    BooleanValue_12=False,
    BooleanValue_13=False,
    BooleanValue_14=False,
    BooleanValue_15=False,
    BooleanValue_16=False,
    BooleanValue_17=False,
    BooleanValue_18=False,
    BooleanValue_19=False,
    BooleanValue_2=False,
    BooleanValue_3=True,
    BooleanValue_4=False,
    BooleanValue_5=False,
    BooleanValue_6=False,
    BooleanValue_7=False,
    BooleanValue_8=False,
    BooleanValue_9=False,
    Color_0=RGBA(0, 0, 0, 0),
    Color_1=RGBA(0, 0, 0, 0),
    Color_10=RGBA(0, 0, 0, 0),
    Color_11=RGBA(0, 0, 0, 0),
    Color_12=RGBA(0, 0, 0, 0),
    Color_13=RGBA(0, 0, 0, 0),
    Color_14=RGBA(0, 0, 0, 0),
    Color_15=RGBA(0, 0, 0, 0),
    Color_16=RGBA(0, 0, 0, 0),
    Color_17=RGBA(0, 0, 0, 0)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)  # -> Out, SolarEnergy, EnergyDensity, Grid

obj_3 = SceneObject(
    Geometry=mesh_2,
    BooleanValue_0=False,
    BooleanValue_1=False,
    Color_0=RGBA(0, 0, 0, 0),
    Color_1=RGBA(0, 0, 0, 0),
    Hidden_0=False,
    Hidden_1=False,
    IntegerValue_0=-2147483648,
    IntegerValue_1=-2147483648,
    IntervalMax_0=-1.797693135e+308,
    IntervalMax_1=-1.797693135e+308,
    IntervalMin_0=-1.797693135e+308,
    IntervalMin_1=-1.797693135e+308,
    Name_0="Geometry",
    Name_1="Material",
    NumberValue_0=-1.797693135e+308,
    NumberValue_1=-1.797693135e+308,
    OutputHidden_0=False,
    OutputName_0="Scene Object",
    TextValuePersistent_1="OutsideFacade_30",
    TextValueVolatile_1="OutsideFacade_30")
grid_3 = DaylightingGrid(
    Geometry=srf_2,
    Spacing=0.45,
    BooleanValue_0=False,
    BooleanValue_1=False,
    BooleanValue_10=False,
    BooleanValue_11=False,
    BooleanValue_12=False,
    BooleanValue_13=False,
    BooleanValue_14=False,
    BooleanValue_15=False,
    BooleanValue_16=False,
    BooleanValue_17=False,
    BooleanValue_18=False,
    BooleanValue_19=False,
    BooleanValue_2=False,
    BooleanValue_20=False,
    BooleanValue_21=False,
    BooleanValue_22=False,
    BooleanValue_3=False,
    BooleanValue_4=False,
    BooleanValue_5=False,
    BooleanValue_6=False,
    BooleanValue_7=False,
    BooleanValue_8=False,
    BooleanValue_9=False,
    Color_0=RGBA(0, 0, 0, 0),
    Color_1=RGBA(0, 0, 0, 0),
    Color_10=RGBA(0, 0, 0, 0),
    Color_11=RGBA(0, 0, 0, 0),
    Color_12=RGBA(0, 0, 0, 0),
    Color_13=RGBA(0, 0, 0, 0),
    Color_14=RGBA(0, 0, 0, 0)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)
rad_map_3 = RadiationMap(
    Name="PV",
    Grids=grid_3,
    Objects=obj_3,
    RhinoScene=Toggle(True),
    Run=Button(),
    BooleanValue_0=False,
    BooleanValue_1=False,
    BooleanValue_10=False,
    BooleanValue_11=False,
    BooleanValue_12=False,
    BooleanValue_13=False,
    BooleanValue_14=False,
    BooleanValue_15=False,
    BooleanValue_16=False,
    BooleanValue_17=False,
    BooleanValue_18=False,
    BooleanValue_19=False,
    BooleanValue_2=False,
    BooleanValue_3=True,
    BooleanValue_4=False,
    BooleanValue_5=False,
    BooleanValue_6=False,
    BooleanValue_7=False,
    BooleanValue_8=False,
    BooleanValue_9=False,
    Color_0=RGBA(0, 0, 0, 0),
    Color_1=RGBA(0, 0, 0, 0),
    Color_10=RGBA(0, 0, 0, 0),
    Color_11=RGBA(0, 0, 0, 0),
    Color_12=RGBA(0, 0, 0, 0),
    Color_13=RGBA(0, 0, 0, 0),
    Color_14=RGBA(0, 0, 0, 0),
    Color_15=RGBA(0, 0, 0, 0),
    Color_16=RGBA(0, 0, 0, 0),
    Color_17=RGBA(0, 0, 0, 0)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)  # -> Out, SolarEnergy, EnergyDensity, Grid

grid_v = GridViewer(
    Grid=rad_map.Grid,
    SRMin="0",
    SRMax="1900",
    active_element_0="Show Legend",
    active_element_1="Show Grid Faces",
    active_element_2="Show Grid Wires",
    annual_metric=0,
    BooleanValue_0=False,
    BooleanValue_1=False,
    BooleanValue_10=False,
    BooleanValue_11=False,
    BooleanValue_12=False,
    BooleanValue_13=False,
    BooleanValue_14=False,
    BooleanValue_15=False,
    BooleanValue_16=False,
    BooleanValue_17=False,
    BooleanValue_18=False,
    BooleanValue_19=False,
    BooleanValue_2=False,
    BooleanValue_20=False,
    BooleanValue_3=False,
    BooleanValue_4=False,
    BooleanValue_5=False,
    BooleanValue_6=False,
    BooleanValue_7=False,
    BooleanValue_8=False,
    BooleanValue_9=False,
    Color_0=RGBA(0, 0, 0, 0),
    Color_1=RGBA(0, 0, 0, 0),
    Color_10=RGBA(0, 0, 0, 0),
    Color_11=RGBA(0, 0, 0, 0),
    Color_12=RGBA(0, 0, 0, 0)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)  # -> Faces, SensorPts, SensorData, SolarRad

grid_v_2 = GridViewer(
    Grid=rad_map_2.Grid,
    SRMin="0",
    SRMax="1900",
    active_element_0="Show Legend",
    active_element_1="Show Grid Faces",
    active_element_2="Show Grid Wires",
    annual_metric=0,
    BooleanValue_0=False,
    BooleanValue_1=False,
    BooleanValue_10=False,
    BooleanValue_11=False,
    BooleanValue_12=False,
    BooleanValue_13=False,
    BooleanValue_14=False,
    BooleanValue_15=False,
    BooleanValue_16=False,
    BooleanValue_17=False,
    BooleanValue_18=False,
    BooleanValue_19=False,
    BooleanValue_2=False,
    BooleanValue_20=False,
    BooleanValue_3=False,
    BooleanValue_4=False,
    BooleanValue_5=False,
    BooleanValue_6=False,
    BooleanValue_7=False,
    BooleanValue_8=False,
    BooleanValue_9=False,
    Color_0=RGBA(0, 0, 0, 0),
    Color_1=RGBA(0, 0, 0, 0),
    Color_10=RGBA(0, 0, 0, 0),
    Color_11=RGBA(0, 0, 0, 0),
    Color_12=RGBA(0, 0, 0, 0)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)  # -> Faces, SensorPts, SensorData, SolarRad

grid_v_3 = GridViewer(
    Grid=rad_map_3.Grid,
    SRMin="0",
    SRMax="1900",
    active_element_0="Show Legend",
    active_element_1="Show Grid Faces",
    active_element_2="Show Grid Wires",
    annual_metric=0,
    BooleanValue_0=False,
    BooleanValue_1=False,
    BooleanValue_10=False,
    BooleanValue_11=False,
    BooleanValue_12=False,
    BooleanValue_13=False,
    BooleanValue_14=False,
    BooleanValue_15=False,
    BooleanValue_16=False,
    BooleanValue_17=False,
    BooleanValue_18=False,
    BooleanValue_19=False,
    BooleanValue_2=False,
    BooleanValue_20=False,
    BooleanValue_3=False,
    BooleanValue_4=False,
    BooleanValue_5=False,
    BooleanValue_6=False,
    BooleanValue_7=False,
    BooleanValue_8=False,
    BooleanValue_9=False,
    Color_0=RGBA(0, 0, 0, 0),
    Color_1=RGBA(0, 0, 0, 0),
    Color_10=RGBA(0, 0, 0, 0),
    Color_11=RGBA(0, 0, 0, 0),
    Color_12=RGBA(0, 0, 0, 0)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)  # -> Faces, SensorPts, SensorData, SolarRad

# ----
# Grid Faces [m2]
# Total Energy [kwh]
area = Area(Geometry=grid_v.Faces)  # -> Area, Centroid
ma = MassAddition(Input=flatten(area.Area))  # -> Result, PartialResults
multiplication = Multiplication(A=flatten(area.Area), B=flatten(grid_v.SolarRad))
ma_2 = MassAddition(Input=multiplication)  # -> Result, PartialResults
division = Division(A=ma_2.Result, B=ma.Result)

# ----
# Grid Faces [m2]
# Total Energy [kwh]
area_2 = Area(Geometry=grid_v_2.Faces)  # -> Area, Centroid
ma_3 = MassAddition(Input=flatten(area_2.Area))  # -> Result, PartialResults
multiplication_2 = Multiplication(A=flatten(area_2.Area), B=flatten(grid_v_2.SolarRad))
ma_4 = MassAddition(Input=multiplication_2)  # -> Result, PartialResults
division_2 = Division(A=ma_4.Result, B=ma_3.Result)

# ----
# Grid Faces [m2]
# Total Energy [kwh]
area_3 = Area(Geometry=grid_v_3.Faces)  # -> Area, Centroid
ma_5 = MassAddition(Input=flatten(area_3.Area))  # -> Result, PartialResults
multiplication_3 = Multiplication(A=flatten(area_3.Area), B=flatten(grid_v_3.SolarRad))
ma_6 = MassAddition(Input=multiplication_3)  # -> Result, PartialResults
division_3 = Division(A=ma_6.Result, B=ma_5.Result)

# ----
# Total Area [m2]
# Average [kwh/m2]
# Total Energy [kwh]
panel = Panel(ma.Result)
# Superfícies [kwh]
# Superfícies
# [kwh/m2]
# Superfícies [m2]
# Superfícies [kwh]
# Energia Total [kwh]
# Média das Superfícies [kwh/m2]
# Superfícies
# [kwh/m2]
# Desvio das superfícies [kwh/m2]
# Área Total [m2]
# Superfícies [m2]
# Média Total [kwh/m2]
# Superfícies [kwh]
# Energia Total [kwh]
# Média das Superfícies [kwh/m2]
# Superfícies
# [kwh/m2]
# Desvio das superfícies [kwh/m2]
# Área Total [m2]
# Superfícies [m2]
# Média Total [kwh/m2]
# Superfícies [kwh]
# Energia Total [kwh]
# Média das Superfícies [kwh/m2]
# Superfícies
# [kwh/m2]
# Desvio das superfícies [kwh/m2]
# Área Total [m2]
# Superfícies [m2]
# Média Total [kwh/m2]
# Superfícies [kwh]
# Energia Total [kwh]
# Média das Superfícies [kwh/m2]
# Superfícies
# [kwh/m2]
# Desvio das superfícies [kwh/m2]
# Área Total [m2]
# Superfícies [m2]
# Média Total [kwh/m2]
# Superfícies [kwh]
# Energia Total [kwh]
# Média das Superfícies [kwh/m2]
# Superfícies
# [kwh/m2]
# Desvio das superfícies [kwh/m2]
# Área Total [m2]
# Superfícies [m2]
# Média Total [kwh/m2]
# Superfícies [kwh]
# Energia Total [kwh]
# Média das Superfícies [kwh/m2]
# Superfícies
# [kwh/m2]
# Desvio das superfícies [kwh/m2]
panel_2 = Panel(ma_2.Result)
panel_3 = Panel(division)

# ----
# Total Area [m2]
# Average [kwh/m2]
# Total Energy [kwh]
panel_4 = Panel(ma_3.Result)
panel_5 = Panel(ma_4.Result)
panel_6 = Panel(division_2)

# ----
# Total Area [m2]
# Average [kwh/m2]
# Total Energy [kwh]
panel_7 = Panel(ma_5.Result)
panel_8 = Panel(ma_6.Result)
panel_9 = Panel(division_3)

# ----
# Total Area [m2]
# Averages [kwh/m2]
# Total Energy [kwh/year]
merge = Merge(Data1=panel_8, Data2=panel_5, Data3=panel_2)
merge_2 = Merge(Data1=panel_7, Data2=panel_4, Data3=panel)
panel_10 = Panel(merge_2)
panel_11 = Panel(merge)
ma_7 = MassAddition(Input=panel_10)  # -> Result, PartialResults
ma_8 = MassAddition(Input=panel_11)  # -> Result, PartialResults
division_4 = Division(A=ma_8.Result, B=ma_7.Result)
panel_12 = Panel(ma_8.Result)
panel_13 = Panel(ma_7.Result)
# Outputs
panel_14 = Panel(division_4)
